vi "Main_GUI.gvi"   [LabVIEW NXG 5.0.0]
# -> All the controllers have an ON/OFF switch which turns from RED to GREEN for the controller to be enabled.
# -> A control parameter can can be easility identified by Setpoint in the label of the textbox of the WHITE backbround of the textbox. (Note: A grey background indicates an indicator or measured valued.)
# -> The complete setup is based on Arduino and arduino based components, hence, the core functions are written in Arduino IDE using its native language which is based on C++.
# -> For detailed description of circuits, modules, program flow, functions, variables and all possible serial commands please visit the Ardino code file in the Links folder in the file tree.
# -> The specific Arduino board used for this application is Arduino Mega 2560.
# -> The software package used to write the native Arduino code is Ardino Pro IDE Alpha Version 0.1.3 - nightly.20201217 and the GUI is developed in LabVIEW NXG 5.0.
panel controls:
  "Setpoint MFC#1": f64
  "Process Gas": string = "1.0"
  "Setpoint MFC#2": f64
  "Setpoint MFC#3": f64
  "Setpoint MFC#4": f64
  "Process Gas": string = "1.01"
  "Process Gas": string = "0.73"
  "Process Gas": string = "1.01"
  "Setpoint MFC#5": f64
  "Process Gas": string = "0.73"
  "Setpoint BPR-1": f64
  "Tab": i32
  "Tab_2": i32
  "Factory Calibration Gas MFC#1": string = "1.00"
  "Full Scale Range (Factory Calibrated Gas) MFC#1": f64 = 1000
  "Vmax @100% Detection Limit MFC#1": f64 = 5
  "Vmin @0% Detection Limit MFC#1": f64
  "Process Gas MFC#1": string = "1.0"
  "Factory Calibration Gas MFC#2": string = "0.72"
  "Full Scale Range (Factory Calibrated Gas) MFC#2": f64 = 100
  "Vmax @100% Detection Limit MFC#2": f64 = 5
  "Vmin @0% Detection Limit MFC#2": f64
  "Process Gas MFC#2": string = "1.39"
  "Factory Calibration Gas MFC#3": string = "0.73"
  "Full Scale Range (Factory Calibrated Gas) MFC#3": f64 = 100
  "Vmax @100% Detection Limit MFC#3": f64 = 5
  "Vmin @0% Detection Limit MFC#3": f64
  "Process Gas MFC#3": string = "0.73"
  "Factory Calibration Gas MFC#4": string = "1.01"
  "Full Scale Range (Factory Calibrated Gas) MFC#4": f64 = 10000
  "Vmax @100% Detection Limit MFC#4": f64 = 5
  "Vmin @0% Detection Limit MFC#4": f64
  "Process Gas MFC#4": string = "1.01"
  "Factory Calibration Gas MFC#5": string = "0.73"
  "Full Scale Range (Factory Calibrated Gas) MFC#5": f64 = 1000
  "Vmax @100% Detection Limit MFC#5": f64 = 5
  "Vmin @0% Detection Limit MFC#5": f64
  "Process Gas MFC#5": string = "0.73"
  "Factory Calibration Gas MFM#1": string = "0.73"
  "Full Scale Range (Factory Calibrated Gas) MFM#1": f64 = 1000
  "Vmax @100% Detection Limit MFM#1": f64 = 5
  "Vmin @0% Detection Limit MFM#1": f64 = 1
  "Process Gas MFM#1": string = "1.0"
  "Factory Calibration Gas MFM#2": string = "1.0"
  "Full Scale Range (Factory Calibrated Gas) MFM#2": f64 = 1000
  "Vmax @100% Detection Limit MFM#2": f64 = 5
  "Vmin @0% Detection Limit MFM#2": f64
  "Process Gas MFM#2": string = "1.0"
  "Vmax @100% Detection Limit PT#1": f64 = 5
  "Vmin @0% Detection Limit PT#1": f64 = 1
  "Full Scale Detection Range PT#1": f64 = 500
  "Vmax @100% Detection Limit PT#2": f64 = 5
  "Vmin @0% Detection Limit PT#2": f64 = 1
  "Full Scale Detection Range PT#2": f64 = 600
  "Vmax @100% Detection Limit BPR#1": f64 = 10
  "Vmin @0% Detection Limit BPR#1": f64
  "Full Scale Detection Range BPR#1": f64 = 500
  "Vmax @100% Detection Limit NDIR": f64 = 5
  "Vmin @0% Detection Limit NDIR": f64 = 1
  "Full Scale Detection Range NDIR": f64 = 20000
  "Vmax @100% Detection Limit ppbLAD": f64 = 5
  "Vmin @0% Detection Limit ppbLAD": f64 = 1
  "Full Scale Detection Range ppbLAB": f64 = 40
  "Switch MFC#1": bool
  "Switch MFC#2": bool
  "Switch MFC#3": bool
  "Switch MFC#4": bool
  "Switch MFC#5": bool
  "Switch BPR#1": bool
  "Ammoia Cylinder Heating Jacket": bool
  "HP NH3 Delivery System Tubing": bool
  "HP-HT Mass Flow Controller": bool
  "Not Connected Yet": bool
  "Zero Offsets": bool
  "Tab_3": i32
  "Capture Data": bool
  "Select Event for Data Collection": enum{"0", "1", "2"} = "0"
  "array type": f64[][]
panel indicators:
  "Reading MFC#1": f64
  "Maximum Flow": f64
  "Reading MFC#2": f64
  "Maximum Flow": f64
  "Reading MFC#3": f64
  "Maximum Flow": f64
  "Reading MFC#4": f64
  "Maximum Flow": f64
  "TC-1": f64
  "TC-2": f64
  "TC-4": f64
  "TC-3": f64
  "PT-1": f64
  "TC-6": f64
  "TC-7": f64
  "TC-5": f64
  "Reading MFC#5": f64
  "Maximum Flow": f64
  "PT-2": f64
  "BPR_1": f64
  "MFM-1": f64
  "MFM-2": f64
  "NDIR Ammonia Concentration": f64
  "Gas Calibration Factor in Use": f64
  "ppb Ammonia Concentration": f64
  "Full Scale Range (Process Gas) MFC#1": f64
  "Scaling Factor MFC#1": f64
  "Offset @No Signal MFC#1": f64
  "Full Scale Range (Process Gas) MFC#2": f64
  "Scaling Factor MFC#2": f64
  "Offset @No Signal MFC#2": f64
  "Full Scale Range (Process Gas) MFC#3": f64
  "Scaling Factor MFC#3": f64
  "Offset @No Signal MFC#3": f64
  "Full Scale Range (Process Gas) MFC#4": f64
  "Scaling Factor MFC#4": f64
  "Offset @No Signal MFC#4": f64
  "Full Scale Range (Process Gas) MFC#5": f64
  "Scaling Factor MFC#5": f64
  "Offset @No Signal MFC#5": f64
  "Full Scale Range (Process Gas) MFM#1": f64
  "Scaling Factor MFM#1": f64
  "Offset @No Signal MFM#1": f64
  "Full Scale Range (Process Gas) MFM#2": f64
  "Scaling Factor MFM#2": f64
  "Offset @No Signal MFM#2": f64
  "Scaling Factor PT#1": f64
  "Scaling Factor PT#2": f64
  "Scaling Factor BPR#1": f64
  "Scaling Factor NDIR": f64
  "Scaling Factor ppbLAD": f64
  "Offset @No Signal PT#1": f64
  "Offset @No Signal PT#2": f64
  "Offset @No Signal BPR#1": f64
  "Offset @ 0 ppm Ammonia Concentration": f64
  "Offset @ 0 ppm Ammonia Concentration (ppbLAD)": f64
  "Mass Flow Rate": f64[]
  "Pressure": f64[]
  "Temperature": f64[]
  "GC Compositition": f64
  "Ammonia Permeance Test": string[][]
  "loop iteration": i32
uses:
  NI::VISA::Configure Serial Port (Instr).gvi
  NI::VISA::Open (Instr).gvi
  NI::Reporting::Excel::Report.gtype::New Excel Report.gvi
  NI::Reporting::Excel::Insert Excel Data (DBL).gvi
  NI::Reporting::Excel::Report.gtype::Close Excel Report.gvi
  NI::VISA::Close (Instr).gvi
diagram:
  # N2 Permeance/Leak Testing
  Concatenate Strings("Date", "\t", "Time", "\t", "Run Time (hr)", "\t", "Pressure (psi)", "\t", "Temperature (C)", "\t", "N2 Flow Rate (sccm)", "\t", "Permate Flow Rate (sccm)", "\r\n") -> w1
  call "Configure Serial Port (Instr).gvi"(stop bits="1.0"(10), session in="COM7", termination char=0x3B) -> (session out=w2, error out=w3)
  call "Open (Instr).gvi"(resource name=w2, error in=w3) -> (session out=w4, error out=w5)
  # CMR Performance Testing
  Concatenate Strings("Date", "\t", "Time", "\t", "Run Time (hr)", "\t", "Pressure (psi)", "\t", "Temperature (C)", "\t", "NH3 Mass Flow Rate (sccm)", "\t", "Retentate Mass Flow Rate (sccm)", "\t", "Permate Mass Flow Rate (sccm)", "\t", "GC - N2 Mol Frac", "\t", "GC - NH3 Mol Frac", "\t", "GC - H2 Mol Frac", "\t", "NDIR - NH3 Conc. (ppm)", "\r\n") -> w6
  # H2 Permeance Testing
  Concatenate Strings("Date", "\t", "Time", "\t", "Run Time (hr)", "\t", "Pressure (psi)", "\t", "Temperature (C)", "\t", "N2 Flow Rate (sccm)", "\t", "Permate Flow Rate (sccm)", "\r\n") -> w7
  Get Current Time() -> (current time=w8)
  s1 = w1  # shift register
  s2 = w7  # shift register
  s3 = w6  # shift register
  while (iteration -> i1) {
    sequence {
      frame 0 {
        Select(s=$"Zero Offsets", t=TRUE, f=FALSE) -> w9
        case (w9) {
          frame False, Default {
            w10 = w5
            w11 = default
            w12 = default
            w13 = default
            w14 = default
            w15 = default
            w16 = default
            w17 = default
            w18 = default
            w19 = default
            w20 = default
            w21 = default
            w22 = default
            w23 = w4
          }
          frame True {
            call "Serial_Read.gvi"(session in=w4, error in=w5, INST_Code_Sr#="MFC01") -> (session out=w24, error out=w25, Serial Output=w11)
            call "Serial_Read.gvi"(session in=w24, error in=w25, INST_Code_Sr#="MFC02") -> (session out=w26, error out=w27, Serial Output=w12)
            call "Serial_Read.gvi"(session in=w26, error in=w27, INST_Code_Sr#="MFC03") -> (session out=w28, error out=w29, Serial Output=w13)
            call "Serial_Read.gvi"(session in=w28, error in=w29, INST_Code_Sr#="MFC04") -> (session out=w30, error out=w31, Serial Output=w14)
            call "Serial_Read.gvi"(session in=w30, error in=w31, INST_Code_Sr#="MFC05") -> (session out=w32, error out=w33, Serial Output=w15)
            call "Serial_Read.gvi"(session in=w32, error in=w33, INST_Code_Sr#="BPR01") -> (session out=w34, error out=w35, Serial Output=w16)
            call "Serial_Read.gvi"(session in=w34, error in=w35, INST_Code_Sr#="ADC11") -> (session out=w36, error out=w37, Serial Output=w17)
            call "Serial_Read.gvi"(session in=w36, error in=w37, INST_Code_Sr#="ADC12") -> (session out=w38, error out=w39, Serial Output=w18)
            call "Serial_Read.gvi"(session in=w38, error in=w39, INST_Code_Sr#="ADC21") -> (session out=w40, error out=w41, Serial Output=w19)
            call "Serial_Read.gvi"(session in=w40, error in=w41, INST_Code_Sr#="ADC22") -> (session out=w42, error out=w43, Serial Output=w20)
            call "Serial_Read.gvi"(session in=w42, error in=w43, INST_Code_Sr#="ADC31") -> (session out=w44, error out=w45, Serial Output=w21)
            call "Serial_Read.gvi"(session in=w44, error in=w45, INST_Code_Sr#="ADC32") -> (session out=w23, error out=w10, Serial Output=w22)
          }
        }
      }
      frame 1 {
        call "Mass_Flow.gvi"(Factory Calibration Gas=$"Factory Calibration Gas MFC#1", Process Gas=$"Process Gas", Full Scale Range (Factory Calibrated Gas)=$"Full Scale Range (Factory Calibrated Gas) MFC#1", Vmax @100% detection limit=$"Vmax @100% Detection Limit MFC#1", Vmin @0% detection limit=$"Vmin @0% Detection Limit MFC#1") -> (Full Scale Range (Process Gas)=w46, Scaling Factor=w47)
        $"Full Scale Range (Process Gas) MFC#1" <- w46
        $"Scaling Factor MFC#1" <- w47
        call "Mass_Flow.gvi"(Factory Calibration Gas=$"Factory Calibration Gas MFC#2", Process Gas=$"Process Gas", Full Scale Range (Factory Calibrated Gas)=$"Full Scale Range (Factory Calibrated Gas) MFC#2", Vmax @100% detection limit=$"Vmax @100% Detection Limit MFC#2", Vmin @0% detection limit=$"Vmin @0% Detection Limit MFC#2") -> (Full Scale Range (Process Gas)=w48, Scaling Factor=w49)
        $"Full Scale Range (Process Gas) MFC#2" <- w48
        $"Scaling Factor MFC#2" <- w49
        call "Mass_Flow.gvi"(Factory Calibration Gas=$"Factory Calibration Gas MFC#3", Process Gas=$"Process Gas", Full Scale Range (Factory Calibrated Gas)=$"Full Scale Range (Factory Calibrated Gas) MFC#3", Vmax @100% detection limit=$"Vmax @100% Detection Limit MFC#3", Vmin @0% detection limit=$"Vmin @0% Detection Limit MFC#3") -> (Full Scale Range (Process Gas)=w50, Scaling Factor=w51)
        $"Full Scale Range (Process Gas) MFC#3" <- w50
        $"Scaling Factor MFC#3" <- w51
        call "Mass_Flow.gvi"(Factory Calibration Gas=$"Factory Calibration Gas MFC#4", Process Gas=$"Process Gas", Full Scale Range (Factory Calibrated Gas)=$"Full Scale Range (Factory Calibrated Gas) MFC#4", Vmax @100% detection limit=$"Vmax @100% Detection Limit MFC#4", Vmin @0% detection limit=$"Vmin @0% Detection Limit MFC#4") -> (Full Scale Range (Process Gas)=w52, Scaling Factor=w53)
        $"Full Scale Range (Process Gas) MFC#4" <- w52
        $"Scaling Factor MFC#4" <- w53
        call "Mass_Flow.gvi"(Factory Calibration Gas=$"Factory Calibration Gas MFC#5", Process Gas=$"Process Gas", Full Scale Range (Factory Calibrated Gas)=$"Full Scale Range (Factory Calibrated Gas) MFC#5", Vmax @100% detection limit=$"Vmax @100% Detection Limit MFC#5", Vmin @0% detection limit=$"Vmin @0% Detection Limit MFC#5") -> (Full Scale Range (Process Gas)=w54, Scaling Factor=w55)
        $"Full Scale Range (Process Gas) MFC#5" <- w54
        $"Scaling Factor MFC#5" <- w55
        Subtract(x=$"Vmax @100% Detection Limit ppbLAD", y=$"Vmin @0% Detection Limit ppbLAD") -> w56
        Divide(x=$"Full Scale Detection Range ppbLAB", y=w56) -> w57
        $"Scaling Factor ppbLAD" <- w57
        call "Mass_Flow.gvi"(Factory Calibration Gas=$"Factory Calibration Gas MFM#2", Process Gas=$"Process Gas MFM#2", Full Scale Range (Factory Calibrated Gas)=$"Full Scale Range (Factory Calibrated Gas) MFM#2", Vmax @100% detection limit=$"Vmax @100% Detection Limit MFM#2", Vmin @0% detection limit=$"Vmin @0% Detection Limit MFM#2") -> (Full Scale Range (Process Gas)=w58, Scaling Factor=w59)
        $"Full Scale Range (Process Gas) MFM#1" <- w58
        $"Scaling Factor MFM#1" <- w59
        call "Mass_Flow.gvi"(Factory Calibration Gas=$"Factory Calibration Gas MFM#1", Process Gas=$"Process Gas MFM#1", Full Scale Range (Factory Calibrated Gas)=$"Full Scale Range (Factory Calibrated Gas) MFM#1", Vmax @100% detection limit=$"Vmax @100% Detection Limit MFM#1", Vmin @0% detection limit=$"Vmin @0% Detection Limit MFM#1") -> (Full Scale Range (Process Gas)=w60, Scaling Factor=w61)
        $"Full Scale Range (Process Gas) MFM#2" <- w60
        $"Scaling Factor MFM#2" <- w61
        Subtract(x=$"Vmax @100% Detection Limit NDIR", y=$"Vmin @0% Detection Limit NDIR") -> w62
        Divide(x=$"Full Scale Detection Range NDIR", y=w62) -> w63
        $"Scaling Factor NDIR" <- w63
        Subtract(x=$"Vmax @100% Detection Limit PT#1", y=$"Vmin @0% Detection Limit PT#1") -> w64
        Divide(x=$"Full Scale Detection Range PT#1", y=w64) -> w65
        $"Scaling Factor PT#1" <- w65
        Subtract(x=$"Vmax @100% Detection Limit BPR#1", y=$"Vmin @0% Detection Limit BPR#1") -> w66
        Divide(x=$"Full Scale Detection Range BPR#1", y=w66) -> w67
        $"Scaling Factor BPR#1" <- w67
        Subtract(x=$"Vmax @100% Detection Limit PT#2", y=$"Vmin @0% Detection Limit PT#2") -> w68
        Divide(x=$"Full Scale Detection Range PT#2", y=w68) -> w69
        $"Scaling Factor PT#2" <- w69
      }
    }
    call "Serial_Read.gvi"(session in=w23, error in=w10, INST_Code_Sr#="MFC01") -> (session out=w70, error out=w71, Serial Output=w72)
    Subtract(x=w72, y=w11) -> w73
    Multiply(w73, w47) -> w74
    $"Reading MFC#1" <- w74
    call "Serial_Read.gvi"(session in=w70, error in=w71, INST_Code_Sr#="MFC02") -> (session out=w75, error out=w76, Serial Output=w77)
    Subtract(x=w77, y=w12) -> w78
    Multiply(w78, w49) -> w79
    $"Reading MFC#2" <- w79
    $"Maximum Flow" <- w46
    call "Serial_Read.gvi"(session in=w75, error in=w76, INST_Code_Sr#="MFC03") -> (session out=w80, error out=w81, Serial Output=w82)
    Subtract(x=w82, y=w13) -> w83
    Multiply(w83, w51) -> w84
    call "Serial_Read.gvi"(session in=w80, error in=w81, INST_Code_Sr#="MFC04") -> (session out=w85, error out=w86, Serial Output=w87)
    Subtract(x=w87, y=w14) -> w88
    Multiply(w88, w53) -> w89
    call "Serial_Read.gvi"(session in=w85, error in=w86, INST_Code_Sr#="MFC05") -> (session out=w90, error out=w91, Serial Output=w92)
    Subtract(x=w92, y=w15) -> w93
    Multiply(w93, w55) -> w94
    call "Serial_Read.gvi"(session in=w90, error in=w91, INST_Code_Sr#="BPR01") -> (session out=w95, error out=w96, Serial Output=w97)
    call "Serial_Read.gvi"(session in=w95, error in=w96, INST_Code_Sr#="ADC11") -> (session out=w98, error out=w99, Serial Output=w100)
    Subtract(x=w100, y=w17) -> w101
    Multiply(w101, w61) -> w102
    call "Serial_Read.gvi"(session in=w98, error in=w99, INST_Code_Sr#="ADC12") -> (session out=w103, error out=w104, Serial Output=w105)
    Subtract(x=w105, y=w18) -> w106
    Multiply(w106, w59) -> w107
    Build Array(w74, w79, w84, w89, w94, w102, w107) -> w108
    call "Serial_Read.gvi"(session in=w103, error in=w104, INST_Code_Sr#="ADC21") -> (session out=w109, error out=w110, Serial Output=w111)
    call "Serial_Read.gvi"(session in=w109, error in=w110, INST_Code_Sr#="ADC22") -> (session out=w112, error out=w113, Serial Output=w114)
    call "Serial_Read.gvi"(session in=w112, error in=w113, INST_Code_Sr#="ADC31") -> (session out=w115, error out=w116, Serial Output=w117)
    Subtract(x=w117, y=w21) -> w118
    Multiply(w118, w63) -> w119
    Get Current Time() -> (current time=w120)
    Get Date And Time String(time stamp=w120, want seconds? (F)=TRUE) -> (date string=w121, time string=w122)
    Array Index(array=w108) -> (out0[6]=w123)
    Subtract(x=w97, y=w16) -> w124
    Multiply(w124, w67) -> w125
    Subtract(x=w111, y=w19) -> w126
    Multiply(w126, w65) -> w127
    Subtract(x=w114, y=w20) -> w128
    Multiply(w128, w69) -> w129
    Build Array(w127, w129, w125) -> w130
    Array Index(array=w130) -> (out0[1]=w131)
    call "Serial_Read.gvi"(session in=w115, error in=w116, INST_Code_Sr#="ADC32") -> (session out=w132, error out=w133, Serial Output=w134)
    call "Serial_Read.gvi"(session in=w132, error in=w133, INST_Code_Sr#="_TC01") -> (session out=w135, error out=w136, Serial Output=w137)
    call "Serial_Read.gvi"(session in=w135, error in=w136, INST_Code_Sr#="_TC02") -> (session out=w138, error out=w139, Serial Output=w140)
    call "Serial_Read.gvi"(session in=w138, error in=w139, INST_Code_Sr#="_TC03") -> (session out=w141, error out=w142, Serial Output=w143)
    call "Serial_Read.gvi"(session in=w141, error in=w142, INST_Code_Sr#="_TC04") -> (session out=w144, error out=w145, Serial Output=w146)
    call "Serial_Read.gvi"(session in=w144, error in=w145, INST_Code_Sr#="_TC03") -> (session out=w147, error out=w148, Serial Output=w149)
    call "Serial_Read.gvi"(session in=w147, error in=w148, INST_Code_Sr#="_TC06") -> (session out=w150, error out=w151, Serial Output=w152)
    call "Serial_Read.gvi"(session in=w150, error in=w151, INST_Code_Sr#="_TC07") -> (session out=w153, error out=w154, Serial Output=w155)
    Build Array(w137, w140, w143, w146, w149, w152, w155) -> w156
    Array Index(array=w156) -> (out0[6]=w157)
    Timestamp Subtract(x=w120, y=w8) -> w158
    Divide(x=w158, y=3600) -> w159
    case ($"Capture Data") {
      frame False, Default {
        w160 = s1
        w161 = s2
        w162 = s3
      }
      frame True {
        Number To Fractional String(number=w159) -> (F-format string=w163)
        Number To Fractional String(number=w131) -> (F-format string=w164)
        Number To Fractional String(number=w157) -> (F-format string=w165)
        Number To Fractional String(number=w123) -> (F-format string=w166)
        Number To Fractional String(number=w119) -> (F-format string=w167)
        case ($"Select Event for Data Collection") {
          frame "0" {
            Array Index(array=w108) -> (out0[1]=w168)
            Number To Fractional String(number=w168) -> (F-format string=w169)
            Concatenate Strings(w121, "\t", w122, "\t", w163, "\t", w164, "\t", w165, "\t", w169, "\t", w166, "\r\n") -> w170
            Concatenate Strings(s1, w170) -> w160
            w161 = s2
            w162 = s3
          }
          frame "1" {
            Array Index(array=w108) -> (out0[3]=w171)
            Number To Fractional String(number=w171) -> (F-format string=w172)
            Concatenate Strings(w121, "\t", w122, "\t", w163, "\t", w164, "\t", w165, "\t", w172, "\t", w166, "\r\n") -> w173
            Concatenate Strings(s2, w173) -> w161
            w160 = s1
            w162 = s3
          }
          frame "2", Default {
            Select(s=$"Switch MFC#5", t=4, f=2) -> w174
            Array Index(array=w108) -> (out0[w174]=w175)
            Number To Fractional String(number=w175) -> (F-format string=w176)
            Array Index(array=w108) -> (out0[5]=w177)
            Number To Fractional String(number=w177) -> (F-format string=w178)
            call "Get_GC_Composition.gvi"(Sequence Data Folder Path=path "\\ADMIN-CMR-GC\\CMRTest_HighPressure") -> (Nitrogen Concentration from GC=w179, Ammonia Concentation from GC=w180, Hydrogen Concentration from GC=w181)
            Number To Fractional String(number=w179) -> (F-format string=w182)
            Number To Fractional String(number=w180) -> (F-format string=w183)
            Number To Fractional String(number=w181) -> (F-format string=w184)
            Concatenate Strings(w121, "\t", w122, "\t", w163, "\t", w164, "\t", w165, "\t", w176, "\t", w178, "\t", w166, "\t", w182, "\t", w183, "\t", w184, "\t", w167, "\r\n") -> w185
            Concatenate Strings(s3, w185) -> w162
            w160 = s1
            w161 = s2
          }
        }
      }
    }
    $"loop iteration" <- i1
    $"Reading MFC#3" <- w84
    $"Offset @No Signal MFC#2" <- w12
    $"Reading MFC#4" <- w89
    $"Offset @No Signal MFC#1" <- w11
    $"Maximum Flow" <- w48
    $"Reading MFC#5" <- w94
    $"Offset @No Signal MFC#3" <- w13
    Subtract(x=w134, y=w22) -> w186
    Multiply(w186, w57) -> w187
    $"ppb Ammonia Concentration" <- w187
    $"Maximum Flow" <- w50
    $"Offset @No Signal MFC#4" <- w14
    $"Mass Flow Rate" <- w108
    $"Maximum Flow" <- w52
    $Pressure <- w130
    $"NDIR Ammonia Concentration" <- w119
    $"Offset @No Signal MFC#5" <- w15
    $Temperature <- w156
    $"Maximum Flow" <- w54
    $"Offset @ 0 ppm Ammonia Concentration (ppbLAD)" <- w22
    $"Offset @ 0 ppm Ammonia Concentration" <- w21
    $"Offset @No Signal MFM#2" <- w18
    $"TC-1" <- w137
    $"Offset @No Signal MFM#1" <- w17
    $"TC-2" <- w140
    $"TC-3" <- w143
    $BPR_1 <- w125
    $"TC-4" <- w146
    $"Offset @No Signal PT#1" <- w19
    $"PT-1" <- w127
    $"TC-5" <- w149
    $"PT-2" <- w129
    $"Offset @No Signal BPR#1" <- w16
    $"MFM-2" <- w107
    $"TC-6" <- w152
    $"TC-7" <- w155
    $"MFM-1" <- w102
    $"Offset @No Signal PT#2" <- w20
    call "Serial_Write.gvi"(session in=w153, error in=w154, INST_Code_Sr#="MFC01", Setpoint=$"Setpoint MFC#1", Switch=$"Switch MFC#1") -> (session out=w188, error out=w189)
    call "Serial_Write.gvi"(session in=w188, error in=w189, INST_Code_Sr#="MFC02", Setpoint=$"Setpoint MFC#2", Switch=$"Switch MFC#2") -> (session out=w190, error out=w191)
    call "Serial_Write.gvi"(session in=w190, error in=w191, INST_Code_Sr#="MFC03", Setpoint=$"Setpoint MFC#3", Switch=$"Switch MFC#3") -> (session out=w192, error out=w193)
    call "Serial_Write.gvi"(session in=w192, error in=w193, INST_Code_Sr#="MFC04", Setpoint=$"Setpoint MFC#4", Switch=$"Switch MFC#4") -> (session out=w194, error out=w195)
    call "Serial_Write.gvi"(session in=w194, error in=w195, INST_Code_Sr#="MFC05", Setpoint=$"Setpoint MFC#5", Switch=$"Switch MFC#5") -> (session out=w196, error out=w197)
    call "Serial_Write.gvi"(session in=w196, error in=w197, INST_Code_Sr#="BPR01", Setpoint=$"Setpoint BPR-1", Switch=$"Switch BPR#1") -> (session out=w198, error out=w199)
    call "Serial_Write_Relay.gvi"(session in=w198, error in=w199, INST_Code_Sr#="RLY01", Switch=$"Ammoia Cylinder Heating Jacket") -> (session out=w200, error out=w201)
    call "Serial_Write_Relay.gvi"(session in=w200, error in=w201, INST_Code_Sr#="RLY02", Switch=$"HP NH3 Delivery System Tubing") -> (session out=w202, error out=w203)
    call "Serial_Write_Relay.gvi"(session in=w202, error in=w203, INST_Code_Sr#="RLY03", Switch=$"HP-HT Mass Flow Controller") -> (session out=w204, error out=w205)
    call "Serial_Write_Relay.gvi"(session in=w204, error in=w205, INST_Code_Sr#="RLY04", Switch=$"Not Connected Yet") -> (session out=w206, error out=w207)
    next s1 = w160
    next s2 = w161
    next s3 = w162
    continue if TRUE
  }
  disable {
    frame Enabled { }
    frame Disabled {
      Spreadsheet String To Array(array type=$"array type", format string="%f", spreadsheet string=s3) -> (array=w208)
      Spreadsheet String To Array(array type=$"array type", format string="%f", spreadsheet string=s2) -> (array=w209)
      Spreadsheet String To Array(array type=$"array type", format string="%f", spreadsheet string=s1) -> (array=w210)
      call "New Excel Report.gvi"(sheet name="N2 Permeance Test") -> (report=w211, error out=w212)
      call "Insert Excel Data (DBL).gvi"(report in=w211, 2D data=w210, location="A1", error in=w212, sheet name="N2 Permeance Test") -> (report out=w213, error out=w214)
      call "Insert Excel Data (DBL).gvi"(report in=w213, 2D data=w209, location="A1", error in=w214, sheet name="H2 Permeance Test") -> (report out=w215, error out=w216)
      call "Insert Excel Data (DBL).gvi"(report in=w215, 2D data=w208, location="A1", error in=w216, sheet name="CMR Performance Evaluation") -> (report out=w217, error out=w218)
      call "Close Excel Report.gvi"(report=w217, error in=w218)
    }
  }
  call "Close (Instr).gvi"(session in=w206, error in=w207)
