vi "Get_GC_Composition.gvi"   [LabVIEW NXG 5.0.0]
inputs:
  "Sequence Data Folder Path": path
outputs:
  "Nitrogen Concentration from GC": f64
  "Ammonia Concentation from GC": f64
  "Hydrogen Concentration from GC": f64
panel indicators:
  "folder names": string[]
  "appended path_2": path
  "text": string
  "string array": string[]
uses:
  NI::G Core::Strings::Search and Replace Pattern.gvi
  NI::G Core::Strings::Delimited String to 1D String Array.gvi
diagram:
  List Folder(path=$"Sequence Data Folder Path") -> (error out=w1, folder names=w2)
  $"folder names" <- w2
  Array Size(array=w2) -> (size(s)=w3)
  Subtract(x=w3, y=1) -> w4
  Array Index(array=w2) -> (out0[w4]=w5)
  Build Path(base path=$"Sequence Data Folder Path", name or relative path=w5) -> (appended path=w6)
  List Folder(error in=w1, path=w6, pattern="Test000****") -> (error out=w7, folder names=w8, path out=w9)
  Sort 1D Array(array=w8) -> (sorted array=w10)
  Array Size(array=w10) -> (size(s)=w11)
  Subtract(x=w11, y=2) -> w12
  Array Index(array=w10) -> (out0[w12]=w13)
  Build Path(base path=w9, name or relative path=w13) -> (appended path=w14)
  Build Path(base path=w14, name or relative path="REPORT01.CSV") -> (appended path=w15)
  Open Or Create Or Replace File(error in=w7, file path (use dialog)=w15) -> (error out=w16, refnum out=w17)
  Set File Position(error in=w16, offset (in bytes) (0)=2, refnum=w17) -> (error out=w18, refnum out=w19)
  Read From Text File(error in=w18, file (use dialog)=w19) -> (error out=w20, refnum out=w21, text=w22)
  call "Search and Replace Pattern.gvi"(string=w22, pattern="", replace string="", replace all=TRUE) -> (result string=w23)
  call "Search and Replace Pattern.gvi"(string=w23, pattern="\n", replace string="", replace all=TRUE) -> (result string=w24)
  call "Search and Replace Pattern.gvi"(string=w24, pattern="\"", replace string="", replace all=TRUE) -> (result string=w25)
  call "Search and Replace Pattern.gvi"(string=w25, pattern="-", replace string="", replace all=TRUE) -> (result string=w26)
  call "Search and Replace Pattern.gvi"(string=w26, pattern=" ", replace string="", replace all=TRUE) -> (result string=w27)
  call "Delimited String to 1D String Array.gvi"(delimited string=w27, delimiter=",") -> (string array=w28)
  Array Index(array=w28) -> (out0[4]=w29)
  Floating Point String To Number(string=w29) -> (number=w30)
  $"Nitrogen Concentration from GC" <- w30
  $"appended path_2" <- w15
  Close File(error in=w20, refnum=w21)
  $text <- w27
  $"string array" <- w28
  Array Index(array=w28) -> (out0[11]=w31)
  Floating Point String To Number(string=w31) -> (number=w32)
  Add(w30, w32) -> w33
  Subtract(x=100, y=w33) -> w34
  $"Hydrogen Concentration from GC" <- w34
  $"Ammonia Concentation from GC" <- w32
