vi "Mass_Flow.gvi"   [LabVIEW NXG 5.0.0]
inputs:
  "Factory Calibration Gas": string = "0.73"
  "Full Scale Range (Factory Calibrated Gas)": f64 = 100
  "Process Gas": string = "0.73"
  "Vmax @100% detection limit": f64 = 5
  "Vmin @0% detection limit": f64
outputs:
  "Full Scale Range (Process Gas)": f64
  "Scaling Factor": f64
diagram:
  Floating Point String To Number(string=$"Process Gas") -> (number=w1)
  Floating Point String To Number(string=$"Factory Calibration Gas") -> (number=w2)
  Divide(x=w1, y=w2) -> w3
  Multiply($"Full Scale Range (Factory Calibrated Gas)", w3) -> w4
  $"Full Scale Range (Process Gas)" <- w4
  Subtract(x=$"Vmax @100% detection limit", y=$"Vmin @0% detection limit") -> w5
  Divide(x=w4, y=w5) -> w6
  $"Scaling Factor" <- w6
