vi "Serial_Read.gvi"   [LabVIEW NXG 5.0.0]
inputs:
  "session in": "VISA Instr"
  "error in": error
  "INST_Code_Sr#": string
outputs:
  "session out": "VISA Instr"
  "error out": error
  "Serial Output": f64
panel controls:
  "default value 1": f64
uses:
  NI::VISA::Write (Instr, String).gvi
  NI::VISA::Read (Instr, String).gvi
diagram:
  sequence {
    frame 0 {
      Concatenate Strings(":PV", $"INST_Code_Sr#", ";") -> w1
    }
    frame 1 {
      call "Write (Instr, String).gvi"(session in=$"session in", error in=$"error in", write buffer=w1) -> (session out=w2, error out=w3, return count=w4)
      call "Read (Instr, String).gvi"(session in=w2, error in=w3, byte count=w4) -> (session out=w5, error out=w6, read buffer=w7)
      Search Or Split String(search string/char=";", string=w7) -> (substring before match=w8)
      Scan From String(formatString="%.;%f", inputString=w8, errIn=w6, default=$"default value 1") -> (errOut=w9, out0=w10)
    }
    frame 2 {
      $"session out" <- w5
      $"error out" <- w9
      $"Serial Output" <- w10
    }
  }
