vi "Serial_Write.gvi"   [LabVIEW NXG 5.0.0]
inputs:
  "session in": "VISA Instr"
  "error in": error
  "INST_Code_Sr#": string
  "Switch": bool
  "Setpoint": f64
outputs:
  "session out": "VISA Instr"
  "error out": error
uses:
  NI::VISA::Write (Instr, String).gvi
diagram:
  case ($Switch) {
    frame False, Default {
      w1 = $"error in"
      w2 = $"session in"
    }
    frame True {
      sequence {
        frame 0 {
          Number To Fractional String(number=$Setpoint) -> (F-format string=w3)
          Concatenate Strings(":SV", $"INST_Code_Sr#", w3, ";") -> w4
        }
        frame 1 {
          call "Write (Instr, String).gvi"(session in=$"session in", error in=$"error in", write buffer=w4) -> (session out=w2, error out=w1)
        }
      }
    }
  }
  $"session out" <- w2
  $"error out" <- w1
